test file "RTForwardVehicleSensorFusionTests"
  setup callback:
    % Set SystemTargetFile parameter in the reference model, ForwardVehicleSensorFusion.slx
    try
        tg = evalin('base', 'tg');
    catch
        tg = slrealtime;
    end
    modelSTF = getSTFName(tg);
    load_system("ForwardVehicleSensorFusion");
    set_param("ForwardVehicleSensorFusion","SystemTargetFile",modelSTF);
    save_system("ForwardVehicleSensorFusion");

    % Deploy and run FVSF algorithm on target machine
    helperRTTestManagerSetup('RTForwardVehicleSensorFusionTarget');
  cleanup callback:
    % Stop the model and disconnect the target machine
    tg = evalin('base','tg');
    if tg.isRunning
        tg.stop();
    end

suite "Test Scenarios"

  case "scenario_LFACC_01_Curve_DecelTarget" [simulation]
    model RTForwardVehicleSensorFusionHost
    post-load callback:
      scenarioName = "scenario_LFACC_01_Curve_DecelTarget";
      helperSLForwardVehicleSensorFusionHostSetup("scenarioFcnName",scenarioName);

      % Set SystemTargetFile parameter in the reference model, ForwardVehicleSensorFusion.slx
      try
          tg = evalin('base', 'tg');
      catch
          tg = slrealtime;
      end
      modelSTF = getSTFName(tg);
      load_system("ForwardVehicleSensorFusion");
      set_param("ForwardVehicleSensorFusion","SystemTargetFile",modelSTF);
      save_system("ForwardVehicleSensorFusion");

      % Setup test manager callback to deploy and run FVSF algorithm on target machine.
      helperRTTestManagerSetup('RTForwardVehicleSensorFusionTarget');
    cleanup callback:
      helperPlotForwardVehicleSensorFusionResults(sltest_simout.logsout);

  case "scenario_LFACC_02_Curve_AutoRetarget" [simulation]
    model RTForwardVehicleSensorFusionHost
    post-load callback:
      scenarioName = "scenario_LFACC_02_Curve_AutoRetarget";
      helperSLForwardVehicleSensorFusionHostSetup("scenarioFcnName",scenarioName);

      % Set SystemTargetFile parameter in the reference model, ForwardVehicleSensorFusion.slx
      try
          tg = evalin('base', 'tg');
      catch
          tg = slrealtime;
      end
      modelSTF = getSTFName(tg);
      load_system("ForwardVehicleSensorFusion");
      set_param("ForwardVehicleSensorFusion","SystemTargetFile",modelSTF);
      save_system("ForwardVehicleSensorFusion");

      % Setup test manager callback to deploy and run FVSF algorithm on target machine.
      helperRTTestManagerSetup('RTForwardVehicleSensorFusionTarget');
    cleanup callback:
      helperPlotForwardVehicleSensorFusionResults(sltest_simout.logsout);

  case "scenario_LFACC_03_Curve_StopnGo" [simulation]
    model RTForwardVehicleSensorFusionHost
    post-load callback:
      scenarioName = "scenario_LFACC_03_Curve_StopnGo";
      helperSLForwardVehicleSensorFusionHostSetup("scenarioFcnName",scenarioName);

      % Set SystemTargetFile parameter in the reference model, ForwardVehicleSensorFusion.slx
      try
          tg = evalin('base', 'tg');
      catch
          tg = slrealtime;
      end
      modelSTF = getSTFName(tg);
      load_system("ForwardVehicleSensorFusion");
      set_param("ForwardVehicleSensorFusion","SystemTargetFile",modelSTF);
      save_system("ForwardVehicleSensorFusion");

      % Setup test manager callback to deploy and run FVSF algorithm on target machine.
      helperRTTestManagerSetup('RTForwardVehicleSensorFusionTarget');
    cleanup callback:
      helperPlotForwardVehicleSensorFusionResults(sltest_simout.logsout);

  case "scenario_LFACC_04_Curve_CutInOut" [simulation]
    model RTForwardVehicleSensorFusionHost
    post-load callback:
      scenarioName = "scenario_LFACC_04_Curve_CutInOut";
      helperSLForwardVehicleSensorFusionHostSetup("scenarioFcnName",scenarioName);

      % Set SystemTargetFile parameter in the reference model, ForwardVehicleSensorFusion.slx
      try
          tg = evalin('base', 'tg');
      catch
          tg = slrealtime;
      end
      modelSTF = getSTFName(tg);
      load_system("ForwardVehicleSensorFusion");
      set_param("ForwardVehicleSensorFusion","SystemTargetFile",modelSTF);
      save_system("ForwardVehicleSensorFusion");

      % Setup test manager callback to deploy and run FVSF algorithm on target machine.
      helperRTTestManagerSetup('RTForwardVehicleSensorFusionTarget');
    cleanup callback:
      helperPlotForwardVehicleSensorFusionResults(sltest_simout.logsout);

  case "scenario_LFACC_05_Curve_CutInOut_TooClose" [simulation]
    model RTForwardVehicleSensorFusionHost
    post-load callback:
      scenarioName = "scenario_LFACC_05_Curve_CutInOut_TooClose";
      helperSLForwardVehicleSensorFusionHostSetup("scenarioFcnName",scenarioName);

      % Set SystemTargetFile parameter in the reference model, ForwardVehicleSensorFusion.slx
      try
          tg = evalin('base', 'tg');
      catch
          tg = slrealtime;
      end
      modelSTF = getSTFName(tg);
      load_system("ForwardVehicleSensorFusion");
      set_param("ForwardVehicleSensorFusion","SystemTargetFile",modelSTF);
      save_system("ForwardVehicleSensorFusion");

      % Setup test manager callback to deploy and run FVSF algorithm on target machine.
      helperRTTestManagerSetup('RTForwardVehicleSensorFusionTarget');
    cleanup callback:
      helperPlotForwardVehicleSensorFusionResults(sltest_simout.logsout);

  case "scenario_LFACC_06_Straight_StopandGoLeadCar" [simulation]
    model RTForwardVehicleSensorFusionHost
    post-load callback:
      scenarioName = "scenario_LFACC_06_Straight_StopandGoLeadCar";
      helperSLForwardVehicleSensorFusionHostSetup("scenarioFcnName",scenarioName);

      % Set SystemTargetFile parameter in the reference model, ForwardVehicleSensorFusion.slx
      try
          tg = evalin('base', 'tg');
      catch
          tg = slrealtime;
      end
      modelSTF = getSTFName(tg);
      load_system("ForwardVehicleSensorFusion");
      set_param("ForwardVehicleSensorFusion","SystemTargetFile",modelSTF);
      save_system("ForwardVehicleSensorFusion");

      % Setup test manager callback to deploy and run FVSF algorithm on target machine.
      helperRTTestManagerSetup('RTForwardVehicleSensorFusionTarget');
    cleanup callback:
      helperPlotForwardVehicleSensorFusionResults(sltest_simout.logsout);

  case "scenario_FVSF_01_Curve_FourVehicles" [simulation]
    model RTForwardVehicleSensorFusionHost
    post-load callback:
      scenarioName = "scenario_FVSF_01_Curve_FourVehicles";
      helperSLForwardVehicleSensorFusionHostSetup("scenarioFcnName",scenarioName);

      % Set SystemTargetFile parameter in the reference model, ForwardVehicleSensorFusion.slx
      try
          tg = evalin('base', 'tg');
      catch
          tg = slrealtime;
      end
      modelSTF = getSTFName(tg);
      load_system("ForwardVehicleSensorFusion");
      set_param("ForwardVehicleSensorFusion","SystemTargetFile",modelSTF);
      save_system("ForwardVehicleSensorFusion");

      % Setup test manager callback to deploy and run FVSF algorithm on target machine.
      helperRTTestManagerSetup('RTForwardVehicleSensorFusionTarget');
    cleanup callback:
      helperPlotForwardVehicleSensorFusionResults(sltest_simout.logsout);

  case "scenario_FVSF_02_Straight_FourVehicles" [simulation]
    model RTForwardVehicleSensorFusionHost
    post-load callback:
      scenarioName = "scenario_FVSF_02_Straight_FourVehicles";
      helperSLForwardVehicleSensorFusionHostSetup("scenarioFcnName",scenarioName);

      % Set SystemTargetFile parameter in the reference model, ForwardVehicleSensorFusion.slx
      try
          tg = evalin('base', 'tg');
      catch
          tg = slrealtime;
      end
      modelSTF = getSTFName(tg);
      load_system("ForwardVehicleSensorFusion");
      set_param("ForwardVehicleSensorFusion","SystemTargetFile",modelSTF);
      save_system("ForwardVehicleSensorFusion");

      % Setup test manager callback to deploy and run FVSF algorithm on target machine.
      helperRTTestManagerSetup('RTForwardVehicleSensorFusionTarget');
    cleanup callback:
      helperPlotForwardVehicleSensorFusionResults(sltest_simout.logsout);

  case "scenario_FVSF_03_Curve_SixVehicles" [simulation]
    model RTForwardVehicleSensorFusionHost
    post-load callback:
      scenarioName = "scenario_FVSF_03_Curve_SixVehicles";
      helperSLForwardVehicleSensorFusionHostSetup("scenarioFcnName",scenarioName);

      % Set SystemTargetFile parameter in the reference model, ForwardVehicleSensorFusion.slx
      try
          tg = evalin('base', 'tg');
      catch
          tg = slrealtime;
      end
      modelSTF = getSTFName(tg);
      load_system("ForwardVehicleSensorFusion");
      set_param("ForwardVehicleSensorFusion","SystemTargetFile",modelSTF);
      save_system("ForwardVehicleSensorFusion");

      % Setup test manager callback to deploy and run FVSF algorithm on target machine.
      helperRTTestManagerSetup('RTForwardVehicleSensorFusionTarget');
    cleanup callback:
      helperPlotForwardVehicleSensorFusionResults(sltest_simout.logsout);

  case "scenario_FVSF_04_Straight_ThreeVehicles" [simulation]
    model RTForwardVehicleSensorFusionHost
    post-load callback:
      scenarioName = "scenario_FVSF_04_Straight_ThreeVehicles";
      helperSLForwardVehicleSensorFusionHostSetup("scenarioFcnName",scenarioName);

      % Set SystemTargetFile parameter in the reference model, ForwardVehicleSensorFusion.slx
      try
          tg = evalin('base', 'tg');
      catch
          tg = slrealtime;
      end
      modelSTF = getSTFName(tg);
      load_system("ForwardVehicleSensorFusion");
      set_param("ForwardVehicleSensorFusion","SystemTargetFile",modelSTF);
      save_system("ForwardVehicleSensorFusion");

      % Setup test manager callback to deploy and run FVSF algorithm on target machine.
      helperRTTestManagerSetup('RTForwardVehicleSensorFusionTarget');
    cleanup callback:
      helperPlotForwardVehicleSensorFusionResults(sltest_simout.logsout);
    assessment "Assessment1": At any point of time, whenever Time > 0.2 is true then, with no delay, MissedTarget == 0 must be true
      Time: signal ForwardVehicleSensorFusionTestBench/Sensors and Environment/Digital Clock, port 1
      MissedTarget: signal ForwardVehicleSensorFusionTestBench/Evaluate Tracker Metrics/GOSPA Metric, port 3

  case "scenario_FVSF_05_Straight_TwoVehicles" [simulation]
    model RTForwardVehicleSensorFusionHost
    post-load callback:
      scenarioName = "scenario_FVSF_05_Straight_TwoVehicles";
      helperSLForwardVehicleSensorFusionHostSetup("scenarioFcnName",scenarioName);

      % Set SystemTargetFile parameter in the reference model, ForwardVehicleSensorFusion.slx
      try
          tg = evalin('base', 'tg');
      catch
          tg = slrealtime;
      end
      modelSTF = getSTFName(tg);
      load_system("ForwardVehicleSensorFusion");
      set_param("ForwardVehicleSensorFusion","SystemTargetFile",modelSTF);
      save_system("ForwardVehicleSensorFusion");

      % Setup test manager callback to deploy and run FVSF algorithm on target machine.
      helperRTTestManagerSetup('RTForwardVehicleSensorFusionTarget');
    cleanup callback:
      helperPlotForwardVehicleSensorFusionResults(sltest_simout.logsout);
    assessment "Assessment1": At any point of time, whenever Time > 0.2 is true then, with no delay, MissedTarget == 0 must be true
      Time: signal ForwardVehicleSensorFusionTestBench/Sensors and Environment/Digital Clock, port 1
      MissedTarget: signal ForwardVehicleSensorFusionTestBench/Evaluate Tracker Metrics/GOSPA Metric, port 3